# Grasshopper definition Assignment3_ParamestricCanopy.gh (Grasshopper 1.0.8)
# plug-ins: RhinoCodePluginGH, Human, Weaverbird, NGon_RH8

# ---- group: Inputs 1
pt = Point([Point(-10.21640893, -18.83770938, 17.5282154), Point(37.82404406, 45.36881961, 28.24418733), Point(-53.27701527, 89.35781978, 25.66891808), Point(-19.12453429, 12.83842823, 37.69293723), Point(37.96347717, -38.57995733, 19.81409002), Point(28.78203234, -18.01573082, -13.34450335), Point(-26.90943717, 55.44288629, -23.54986982)])
srf = Surface(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)

# ---- group: Base Surface
number_slider = Slider(80, range=0..200)
number_slider_2 = Slider(1, range=0..4)

# ---- group: Inputs 2
srf_2 = Surface(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)
pt_2 = Point([Point(27.55456611, 53.21474413, 0), Point(-15.76405003, 4.210559617, 0), Point(28.09604881, -52.10364137, 0), Point(74.12207847, -3.370198209, 0), Point(27.82530746, 6.647231775, 34.93904849)])

# ---- group: Base Surface / Inputs 3
srf_3 = Surface(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)
pt_3 = Point([Point(-16.25981471, -19.02354886, -10.78836551), Point(16.31939492, -8.623196562, 8.523594207), Point(-26.02556058, 36.20153892, 11.44395951), Point(-44.1235176, -0.1656593864, 11.44395951), Point(36.73695588, 46.23893779, 17.32064566), Point(55.471322, -74.52698578, 8.371221738), Point(34.08462371, -36.54473642, -10.87551466), Point(4.049941273, 41.00680053, -20.79685385)])

# ---- group: Base Surface
surface_manipulation = Python3Script(PlanarSurface=srf_2, AttractionPoints=pt_2, Strength=number_slider_2, Divisions=number_slider)  # -> out, DeformedSurface; inputs PlanarSurface: Surface, AttractionPoints: list of Point3d, Divisions: Int32
# ---------- surface_manipulation: Python ----------
import Rhino
import rhinoscriptsyntax as rs
import Rhino.Geometry as rg

# Function to check if the input is a planar surface
def validate_planar_surface(surface):
    # Ensure the surface is planar
    if not isinstance(surface, rg.Surface):
        raise ValueError("The input is not a valid surface.")
    
    if not surface.IsPlanar():
        raise ValueError("The input surface is not planar.")
    
    return surface

# Function to apply attraction
def apply_attraction(points, attraction_points, strength):
    deformed_points = []
    
    # Loop over each point in the grid
    for point in points:
        influence = rg.Vector3d(0, 0, 0)
        total_weight = 0  # To normalize the influence
        
        # Apply attraction force from each attraction point
        for attraction_point in attraction_points:
            direction = attraction_point - point
            distance = direction.Length
            direction.Unitize()  # Normalize the direction vector
            
            # Calculate the distance moved in Z direction
            z_diff = attraction_point.Z - point.Z  # The vertical distance to the attractor point
            
            # Weight the influence by the distance, but move only towards the attractor (never beyond)
            weight = 1 / (distance + 1e-6)  # Avoid division by zero, keep the weight proportional to distance
            
            # Apply strength factor directly to the Z difference
            movement = z_diff * weight * strength  # Apply movement in Z direction, influenced by strength
            
            # Prevent moving past the attraction point
            if movement > 0:
                # Only move upwards (towards the attractor)
                influence.Z += min(movement, z_diff)
            else:
                # Only move downwards (away from the attractor)
                influence.Z += max(movement, z_diff)
            
            total_weight += weight
        
        # Normalize the influence to avoid over-amplification
        if total_weight > 0:
            influence.Z /= total_weight
        
        # Deform the point (move towards the attractor point in Z)
        deformed_point = rg.Point3d(point.X, point.Y, point.Z + influence.Z)
        deformed_points.append(deformed_point)
    
    return deformed_points

# Function to generate the deformed surface mesh
def generate_deformed_surface(surface, attraction_points, strength, divisions):
    # Ensure divisions is an integer
    divisions = int(divisions)
    
    # Validate and coerce the surface to planar
    surface_geometry = validate_planar_surface(surface)
    
    # Get the domain for the surface (U, V)
    u_domain = surface_geometry.Domain(0)
    v_domain = surface_geometry.Domain(1)
    
    # Create a list of points on the surface (grid points)
    points = []
    for i in range(divisions + 1):
        u_param = u_domain.T0 + (u_domain.T1 - u_domain.T0) * (i / divisions)
        for j in range(divisions + 1):
            v_param = v_domain.T0 + (v_domain.T1 - v_domain.T0) * (j / divisions)
            point = surface_geometry.PointAt(u_param, v_param)
            points.append(point)
    
    # Apply deformation based on attraction forces
    deformed_points = apply_attraction(points, attraction_points, strength)
    
    # Create a mesh and add deformed points
    mesh = rg.Mesh()

    # Add vertices (deformed points)
    for point in deformed_points:
        mesh.Vertices.Add(point)
    
    # Add faces based on the deformed grid
    for i in range(divisions):
        for j in range(divisions):
            idx1 = i * (divisions + 1) + j
            idx2 = idx1 + 1
            idx3 = (i + 1) * (divisions + 1) + j + 1
            idx4 = idx3 - 1
            
            # Add quadrilateral faces
            mesh.Faces.AddFace(idx1, idx2, idx3, idx4)
    
    return mesh

# Main logic for Grasshopper
planar_surface = PlanarSurface  # Input planar surface (from Grasshopper)
attraction_points = AttractionPoints  # List of attraction points (input from Grasshopper)
strength = Strength  # Strength of attraction (slider input)
divisions = Divisions  # Grid divisions (slider input)

# Ensure input types are correct
if not isinstance(planar_surface, rg.Surface):
    raise ValueError("The provided surface is not a valid Rhino surface.")
if not isinstance(attraction_points, list) or not all(isinstance(pt, rg.Point3d) for pt in attraction_points):
    raise ValueError("Attraction points must be a list of Rhino.Geometry.Point3d objects.")
if not isinstance(strength, (int, float)):
    raise ValueError("Strength must be a numeric value.")
if not isinstance(divisions, int) or divisions <= 0:
    raise ValueError("Divisions must be a positive integer.")

# Generate the deformed surface mesh
deformed_surface = generate_deformed_surface(planar_surface, attraction_points, strength, divisions)

# Output the deformed surface mesh to Grasshopper
DeformedSurface = deformed_surface  # The resulting deformed mesh surface
# ---------- end surface_manipulation ----------
mesh = Mesh(surface_manipulation.DeformedSurface)

# ---- group: Location of Supports
max_min = Python3Script(Mesh=mesh)  # -> out, ExtremaPoints; inputs Mesh: Mesh
# ---------- max_min: Python ----------
import Rhino.Geometry as rg

def find_all_extrema_points(mesh):
    """
    Finds global and local minima and maxima points on a 3D mesh surface based on the Z-coordinate.

    :param mesh: A 3D mesh (Rhino.Geometry.Mesh)
    :return: A list of all extrema points (global and local min/max) as Point3d objects.
    """
    if not isinstance(mesh, rg.Mesh):
        raise ValueError("Input must be a Rhino.Geometry.Mesh object.")
    
    if not mesh.IsValid:
        raise ValueError("The mesh is invalid.")
    
    # Get all vertices of the mesh
    vertices = mesh.Vertices
    topology = mesh.TopologyVertices  # Use topology to get vertex neighbors
    
    # Initialize variables to store global and local min/max points
    global_min_z = float('inf')
    global_max_z = float('-inf')
    global_min_points = []
    global_max_points = []
    local_min_points = []
    local_max_points = []

    # Iterate through all vertices
    for i in range(vertices.Count):
        vertex = vertices[i]
        z = vertex.Z

        # Update global minimum points
        if z < global_min_z:
            global_min_z = z
            global_min_points = [vertex]  # Reset to new global minimum
        elif z == global_min_z:
            global_min_points.append(vertex)  # Add to list if Z matches global minimum

        # Update global maximum points
        if z > global_max_z:
            global_max_z = z
            global_max_points = [vertex]  # Reset to new global maximum
        elif z == global_max_z:
            global_max_points.append(vertex)  # Add to list if Z matches global maximum

        # Check neighbors for local min/max
        neighbors = topology.ConnectedTopologyVertices(i)
        is_local_min = True
        is_local_max = True

        for neighbor_index in neighbors:
            neighbor_vertex = vertices[neighbor_index]
            neighbor_z = neighbor_vertex.Z

            if z >= neighbor_z:
                is_local_min = False
            if z <= neighbor_z:
                is_local_max = False

            # Break early if not a local min/max
            if not is_local_min and not is_local_max:
                break

        # Add to local min/max lists if criteria are met
        if is_local_min:
            local_min_points.append(vertex)
        if is_local_max:
            local_max_points.append(vertex)

    # Combine all points into a single list of Point3d objects
    all_points = global_min_points + global_max_points + local_min_points + local_max_points

    return all_points

# Input from Grasshopper
mesh_surface = Mesh  # Input mesh surface (Rhino.Geometry.Mesh)

# Ensure the input is valid
if mesh_surface is None or not mesh_surface.IsValid:
    raise ValueError("Invalid mesh input.")

# Find all extrema points
extrema_points = find_all_extrema_points(mesh_surface)

# Outputs to Grasshopper
ExtremaPoints = extrema_points  # List of Point3d objects
# ---------- end max_min ----------
pt_4 = Point(max_min.ExtremaPoints)
cullpt = CullDuplicates(Points=pt_4, Tolerance=0.1, CullMode=3)  # -> Points, Indices, Valence
number_of_supports = Slider(2, range=1..10)
pdecon = Deconstruct(Point=cullpt.Points)  # -> XComponent, YComponent, ZComponent
sort = SortList(Keys=pdecon.ZComponent, ValuesA=cullpt.Points)  # -> Keys, ValuesA
split = SplitList(List=sort.ValuesA, Index=number_of_supports)  # -> ListA, ListB
pt_5 = Point(split.ListA)
xy = XYPlane(Origin=Point(0, 0, 0))
project = Project(Geometry=pt_5, Plane=xy)  # -> Geometry, Transform

# ---- group: Fratal Supports
number_slider_3 = Slider(1, range=0..1)
number_slider_4 = Slider(30, range=0..100)
number_slider_5 = Slider(10, range=0.01..10)
number_slider_6 = Slider(3, range=2..8)
number_slider_7 = Slider(24, range=0..30)
toggle = BooleanToggle(True)

supports = Python3Script(
    Start_Points=project.Geometry,
    Length_0=number_slider_5,
    Depth=number_slider_6,
    Length_Multiplier=number_slider_3,
    Angle=number_slider_7,
    Randomness=toggle,
    Random_Offset=number_slider_4)  # -> out, Lines, Points; inputs Start_Points: list of Point3d, Length_0: Double, Depth: Int32, Length_Multiplier: Double
# ---------- supports: Python ----------
import math
import Rhino.Geometry as rg
import random  # Import random module for randomness

# Base case: when the depth of the recursive function is zero, it stops running
def base_case(depth):
    return depth <= 0

# Drawing a branch and collecting points and lines
def draw_tree_branch(start_point, length, angle_xy, angle_z):
    """
    Draws a branch of the tree and returns its endpoint.

    :param start_point: The start point of the branch (Point3d)
    :param length: Length of the branch
    :param angle_xy: Angle in the X-Y plane (radians)
    :param angle_z: Angle from the Z-axis (radians)
    :return: The end point of the branch (Point3d)
    """
    # Calculate the end point of a branch in 3D
    end_point = rg.Point3d(
        start_point.X + length * math.cos(angle_xy) * math.cos(angle_z),  # X component
        start_point.Y + length * math.sin(angle_xy) * math.cos(angle_z),  # Y component
        start_point.Z + length * math.sin(angle_z)                         # Z component
    )
    
    # Create the line between start and end points
    line = rg.Line(start_point, end_point)
    lines_list.append(line)  # Collect line

    points_list.append(start_point)
    points_list.append(end_point)

    return end_point  # Return end_point for recursive use

# Recursive case
def recursive_case(start_point, length, angle_xy, angle_z, depth, max_depth, branches=3, length_multiplier=0.7, angle_offset_xy_max=math.radians(30), angle_offset_z=math.radians(15), randomize_angles=False):
    """
    Recursively generates branches of the tree.

    :param start_point: The start point of the branch (Point3d)
    :param length: Length of the branch
    :param angle_xy: Angle in the X-Y plane (radians)
    :param angle_z: Angle from the Z-axis (radians)
    :param depth: Current depth of recursion
    :param max_depth: Maximum recursion depth
    :param branches: Number of branches per node
    :param length_multiplier: Reduction factor for branch length
    :param angle_offset_xy_max: Maximum angle offset in the X-Y plane
    :param angle_offset_z: Maximum angle offset along the Z-axis
    :param randomize_angles: Boolean for adding randomness to branching angles
    """
    # Stop if base case is met
    if base_case(depth):
        return

    # Draw the branch and add points and lines
    end_point = draw_tree_branch(start_point, length, angle_xy, angle_z)

    # Recursive branching: Generate branches for each level
    for i in range(branches):
        if randomize_angles:
            # Randomly offset the angle in the X-Y plane within ±angle_offset_xy_max
            random_angle_offset = random.uniform(-angle_offset_xy_max, angle_offset_xy_max)
            new_angle_xy = angle_xy + (i - 1) * math.radians(120) + random_angle_offset
        else:
            # If no randomness, keep the angle fixed at 120 degrees between branches
            new_angle_xy = angle_xy + (i - 1) * math.radians(120)

        # Reduce branch length by the multiplier
        new_length = length * length_multiplier

        # Apply an offset for the angle along the Z-axis
        new_angle_z = angle_z + (branches - 1) * angle_offset_z / 2

        # Recursive call for each branch
        recursive_case(end_point, new_length, new_angle_xy, new_angle_z, depth - 1, max_depth, branches, length_multiplier, angle_offset_xy_max, angle_offset_z, randomize_angles)

# Inputs from Grasshopper
Start_Points = Start_Points  # List of starting points (list of Rhino.Geometry.Point3d)
max_depth = Depth  # Maximum depth (integer, connected to slider)
initial_length = Length_0  # Initial branch length (float, connected to slider)
length_multiplier = Length_Multiplier  # Length reduction factor per level (float, 0.1 to 1.0, connected to slider)
angle_z = Angle  # Angle between Z-axis and X-Y plane (degrees, connected to slider)
angle_offset_xy_max = Random_Offset  # Maximum offset in the X-Y plane (degrees, connected to slider)
randomize_angles = Randomness  # Boolean toggle for randomness (True/False)

# Convert the input angle to radians
angle_offset_z = math.radians(angle_z)

# Lists to store points and lines
points_list = []
lines_list = []

# Call the recursive function for each starting point
for start_point in Start_Points:
    recursive_case(
        start_point=start_point,  # Current starting point from Grasshopper
        length=initial_length,
        angle_xy=0,  # Initial angle for the X-Y plane
        angle_z=math.pi / 2,  # Start vertical
        depth=max_depth,
        max_depth=max_depth,
        branches=3,  # Number of branches per node
        length_multiplier=length_multiplier,
        angle_offset_xy_max=math.radians(angle_offset_xy_max),  # Convert to radians
        angle_offset_z=angle_offset_z,
        randomize_angles=randomize_angles
    )

# Outputs to Grasshopper
Lines = lines_list  # Output lines as Rhino.Geometry.Line objects
Points = list(set(points_list))  # Output unique points
# ---------- end supports ----------
pt_6 = Point(supports.Points)

# ----
pdecon_2 = Deconstruct(Point=pt_6)  # -> XComponent, YComponent, ZComponent
sort_2 = SortList(Keys=pdecon_2.ZComponent, ValuesA=pt_6)  # -> Keys, ValuesA
item = ListItem(List=sort_2.ValuesA, Index="-1", Wrap=True)
pdecon_3 = Deconstruct(Point=item)  # -> XComponent, YComponent, ZComponent
vec = VectorXYZ(XComponent=0, YComponent=0, ZComponent=pdecon_3.ZComponent)  # -> Vector, Length
surface_height_1 = Slider(0.7, range=0..2)
surface_height_2 = Slider(0.6, range=0..2)
surface_height_3 = Slider(1, range=0..2)
surface_height = Slider(0.7, range=0..2)
multiplication = Multiplication(A=vec.Vector, B=surface_height)
move = Move(Geometry=mesh, Motion=multiplication)  # -> Geometry, Transform

surface_tessellation = Python3Script(
    Mesh=move.Geometry,
    Resolution=Slider(60, range=0..100),
    Frequency=Slider(42, range=0..50),
    Amplitude=Slider(40, range=0..50))  # -> out, TessellateLines; inputs Mesh: Mesh, Resolution: Int32, Frequency: Int32, Amplitude: Int32
# ---------- surface_tessellation: Python ----------
import math
import Rhino.Geometry as rg

# Input: Mesh (Mesh)
# Output: TessellateLines (Curves)

def tessellate_mesh(mesh, resolution, frequency, amplitude):
    """Tessellates a mesh with X, Y, and diagonal lines that conform to the surface of the mesh.
    
    Args:
        mesh: Input mesh to tessellate (Rhino.Geometry.Mesh).
        resolution: Number of lines in the tessellation.
        frequency: Frequency of the sine function.
        amplitude: Amplitude of the sine function (variation in spacing).
        
    Returns:
        A list of curves forming the tessellation.
    """
    if not isinstance(mesh, rg.Mesh):
        return None

    # Get mesh bounding box and parameters
    bbox = mesh.GetBoundingBox(True)
    min_pt = bbox.Min
    max_pt = bbox.Max

    # Bounding box dimensions
    width = max_pt.X - min_pt.X
    height = max_pt.Y - min_pt.Y

    # Generate tessellation lines
    tessellate_lines = []

    # Generate lines in the X (horizontal) direction
    for i in range(resolution + 1):
        t = i / resolution
        y = min_pt.Y + t * height
        y += math.sin(t * math.pi * frequency) * amplitude  # Apply sine function

        # Create a horizontal line and project it onto the mesh
        start = rg.Point3d(min_pt.X, y, 0)
        end = rg.Point3d(max_pt.X, y, 0)
        line = rg.Line(start, end).ToNurbsCurve()
        projected_line = rg.Curve.ProjectToMesh(line, mesh, rg.Vector3d(0, 0, -1), 0.01)
        if projected_line:
            tessellate_lines.append(projected_line[0])

    # Generate lines in the Y (vertical) direction
    for i in range(resolution + 1):
        t = i / resolution
        x = min_pt.X + t * width
        x += math.sin(t * math.pi * frequency) * amplitude  # Apply sine function

        # Create a vertical line and project it onto the mesh
        start = rg.Point3d(x, min_pt.Y, 0)
        end = rg.Point3d(x, max_pt.Y, 0)
        line = rg.Line(start, end).ToNurbsCurve()
        projected_line = rg.Curve.ProjectToMesh(line, mesh, rg.Vector3d(0, 0, -1), 0.01)
        if projected_line:
            tessellate_lines.append(projected_line[0])

    # Generate long diagonal lines across the surface
    for i in range(resolution + 1):
        t = i / resolution

        # Diagonal line from bottom-left to top-right
        start = rg.Point3d(min_pt.X, min_pt.Y + t * height, 0)
        end = rg.Point3d(max_pt.X, min_pt.Y + t * height - width, 0)
        diagonal1 = rg.Line(start, end).ToNurbsCurve()
        projected_diagonal1 = rg.Curve.ProjectToMesh(diagonal1, mesh, rg.Vector3d(0, 0, -1), 0.01)
        if projected_diagonal1:
            tessellate_lines.append(projected_diagonal1[0])

        # Diagonal line from bottom-right to top-left
        start = rg.Point3d(max_pt.X, min_pt.Y + t * height, 0)
        end = rg.Point3d(min_pt.X, min_pt.Y + t * height + width, 0)
        diagonal2 = rg.Line(start, end).ToNurbsCurve()
        projected_diagonal2 = rg.Curve.ProjectToMesh(diagonal2, mesh, rg.Vector3d(0, 0, -1), 0.01)
        if projected_diagonal2:
            tessellate_lines.append(projected_diagonal2[0])

    return tessellate_lines

# Grasshopper Input: Mesh (Mesh)
Mesh = Mesh  # Connect a mesh object from Grasshopper

# Grasshopper Output: TessellateLines (Curves)

# Parameters
resolution = Resolution  # Number of lines
frequency = Frequency  # Sine wave frequency
amplitude = Amplitude  # Sine wave amplitude

# Generate tessellation
TessellateLines = tessellate_mesh(Mesh, resolution, frequency, amplitude)
# ---------- end surface_tessellation ----------

join = JoinCurves(Curves=surface_tessellation.TessellateLines, Preserve=False)

# ---- group: Final Support Lines
crv = Curve(supports.Lines)

# ---- group: Final Surface Mesh
mesh_2 = Mesh(move.Geometry)

# ---- group: Final curves
crv_2 = Curve(join)

# ----
demesh = DeconstructMesh(Mesh=mesh_2)  # -> Vertices, Faces, Colours, Normals
pdecon_4 = Deconstruct(Point=demesh.Vertices)  # -> XComponent, YComponent, ZComponent
bnd = Bounds(Numbers=pdecon_4.ZComponent)
remap = RemapNumbers(Value=pdecon_4.ZComponent, Source=bnd, Target=Domain(0, 1))  # -> Mapped, Clipped
gradient = Gradient(LowerLimit=0, UpperLimit=1, Parameter=remap.Mapped, stops=[0: RGB(0, 128, 0), 0.5: RGB(255, 255, 0), 1: RGB(255, 0, 0)])
mcol = MeshColours(Mesh=mesh_2, Colours=gradient)

swatch = ColourSwatch(SwatchColor=RGBA(255, 0, 0, 117))
mcol_2 = MeshColours(Mesh=mesh_2, Colours=swatch)
previewlw = CustomPreviewLineweights(Geometry=crv_2, Shader=swatch, Thickness=Slider(5, range=0..10), Absolute=False)

# ---- group: Display
meshpipe = MeshPipe(
    Curve=flatten([crv, crv_2]),
    Radius=Slider(0.5, range=0..1),
    Sides=Slider(10, range=0..20),
    Tolerance=10,
    Ending=Slider(2, range=0..3))
weld = WeldMesh(Mesh=meshpipe, Angle=3.141592654)

# ----
alignvert = AlignVertices(Mesh=weld, Tolerance=0.01)  # -> Result, Count

# ---- group: Display (continued)
weld_2 = WeldMesh(Mesh=alignvert.Result, Radius=0.001, Align=False, Use_RTree=False)

# ----
wbcatmullclark = WeaverbirdsCatmullClarkSubdivision(MeshCurves=weld_2, Level=1, SmoothNakedEdges=1)
preview = CustomPreview(Geometry=wbcatmullclark, Material=ColourSwatch(SwatchColor=RGB(255, 224, 191)))
